# Grasshopper definition callunity.gh (Grasshopper 1.0.7)

brep = Brep([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])
mesh = Mesh(brep)
scale = Scale(Geometry=mesh, Center=Point(0, 0, 0), Factor=Slider(1.11, range=0.01..3))  # -> Geometry, Transform
lng = ListLength(List=mesh)
rotate = Rotate(Geometry=scale.Geometry, Angle=Slider(3.32, range=0..6.28), Plane=PlaneXY(0, 0, 0))  # -> Geometry, Transform
series = Series(Start=0, Step=1, Count=lng)
bnd = Bounds(Numbers=series)
demesh = DeconstructMesh(Mesh=rotate.Geometry)  # -> Vertices, Faces, Colours, Normals
Z = UnitZ(Factor=1)
remap = RemapNumbers(Value=series, Source=bnd, Target=Domain(0, 1))  # -> Mapped, Clipped
dprod = DotProduct(VectorA=demesh.Normals, VectorB=Z, Unitize=False)
bnd_2 = Bounds(Numbers=dprod)
remap_2 = RemapNumbers(Value=dprod, Source=bnd_2, Target=Domain(0, 1))  # -> Mapped, Clipped
hsl = ColourHSL(Alpha=1, Hue=graft(remap.Mapped), Saturation=remap_2.Mapped, Luminance=0.5)
graft = GraftTree(Tree=rotate.Geometry, IncludeEmptyLists=True, IncludeNullItems=True)
series_2 = Series(Start=0, Step=Slider(16.19, range=0..100), Count=Slider(8, range=0..10))
mcol = MeshColours(Mesh=graft, Colours=hsl)
flatten = FlattenTree(Tree=mcol, Path="{0}")
mjoin = MeshJoin(Meshes=flatten)
X = UnitX(Factor=series_2)
move = Move(Geometry=mjoin, Motion=X)  # -> Geometry, Transform
mjoin_2 = MeshJoin(Meshes=move.Geometry)
filter = StreamFilter(Gate=Toggle(False), Stream0=mcol, Stream1=mjoin_2)
flatten_2 = FlattenTree(Tree=filter, Path="{0}")
c_script = CSharpScript(mesh=flatten_2)  # inputs mesh: list of Mesh
# ---------- c_script: C# usings ----------
using System.Linq;
# ---------- c_script: C# ----------
    using(var args = new Rhino.Runtime.NamedParametersEventArgs())
    {
      args.Set("mesh", mesh.ToArray());
      Rhino.Runtime.HostUtils.ExecuteNamedCallback("Unity:FromGrasshopper", args);
    }
# ---------- end c_script ----------
